# Grasshopper definition CreateInterfaceComplex.gh (Grasshopper 1.0.7)
# plug-ins: GHUI

# ----
# Create Individual UI Components
panel = Panel("mySlider")
label = CreateLabel(Name="label", ID="label", Value="My Web Interface", Scale=1, CSS="font-family:Arial;")
button = CreateButton(Name="myButton2", ID="myButton2", Value="Run My Script!")
label_2 = CreateLabel(
    Name="label",
    ID="label",
    Value="A web-based user-interface package for Grasshopper!",
    Scale="3",
    CSS="font-family:Arial;")
slider = CreateSlider(Name=panel, ID=panel, Value=50, Min=0, Max=100)
slider_2 = CreateSlider(Name="mySlider2", ID="mySlider2", Value=50, Min=0, Max=100)

# ----
# Select Where to Create the HTML UI
path = FilePath("C:\Users\pmite\Documents\GitHub\gh-web-ui\GHUI\Web UI\createdInput.html")
panel_2 = Panel(path)

panel_3 = Panel("Layout & Styling")
slider_3 = CreateSlider(HTML=slider)
slider_4 = CreateSlider(HTML=slider_2, CSS="width:100%; height:100px; background:lightgray;")

concat = Concatenate(FragmentA=label, FragmentD=label_2, FragmentB=button)

# ----
# Combine UI Elements into Single Interface
concat_2 = Concatenate(FragmentE=concat, FragmentC=slider_3, FragmentB=slider_4)
vue_ui = BuildVueUI(HTMLPath=path, HTMLString=concat_2)  # -> Success, Path

panel_4 = Panel("Launch Full UI")
html_ui = LaunchHTMLUI(HTMLPath=vue_ui.Path, ShowWindow=Toggle(True))  # -> InputValues, InputIds, InputNames, InputTypes
panel_5 = Panel(html_ui.InputNames)
panel_6 = Panel(html_ui.InputValues)
panel_7 = Panel(html_ui.InputIds)
panel_8 = Panel(html_ui.InputTypes)

# ----
# Use Inputs in Grasshopper!
panel_9 = Panel("1")
item = ListItem(List=panel_6, Index=panel_9, Wrap=True)
item_2 = ListItem(List=panel_6, Index="2", Wrap=True)
pt = ConstructPoint(XCoordinate=item, YCoordinate=item, ZCoordinate=item)
pt_2 = ConstructPoint(XCoordinate=item_2, YCoordinate=item_2, ZCoordinate=item_2)
dist = Distance(PointA=pt, PointB=pt_2)
ln = Line(StartPoint=pt, EndPoint=pt_2)
panel_10 = Panel(dist)
