# Grasshopper definition ServeInterface.gh (Grasshopper 1.0.7)
# plug-ins: GHUI

path = FilePath("C:\Users\pmite\Documents\GitHub\gh-web-ui\GHUI\Web UI\InputVue.html")
panel = Panel(path)
ghui = GrasshopperUI(HTMLPath=path, ShowWindow=Toggle(True))  # -> InputValues, InputIds, InputNames, InputTypes, WebWindow
panel_2 = Panel(ghui.InputTypes)
panel_3 = Panel(ghui.InputIds)
panel_4 = Panel(ghui.InputValues)
panel_5 = Panel(ghui.InputNames)
